# Grasshopper definition Energy_Simulation_for_JV3_Code_Compliance[1].gh (Grasshopper 1.0.7)

ladybug = Ladybug_Ladybug()  # -> Vviiiiiiiiiizzz; plug-in component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
# 1. Define Building Type
honeybee = Honeybee_Honeybee()  # -> Vviiiiiiiiiizzz; plug-in component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

r_value = Slider(1.5, range=0..10)
r_value_2 = Slider(2.8, range=0..10)
r_value_3 = Slider(3.2, range=0..10)
concat = Concatenate(FragmentA="Wall_R", FragmentB=r_value_2)
concat_2 = Concatenate(FragmentA="Floor_R", FragmentB=r_value)
concat_3 = Concatenate(FragmentA="Roof_R", FragmentB=r_value_3)
epnomassmat = Honeybee_EnergyPlusNoMassOpaqueMaterial(name=concat, R_Value=r_value_2)  # -> EPMaterial; plug-in component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
epnomassmat_2 = Honeybee_EnergyPlusNoMassOpaqueMaterial(name=concat_2, R_Value=r_value)  # -> EPMaterial; plug-in component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
epnomassmat_3 = Honeybee_EnergyPlusNoMassOpaqueMaterial(name=concat_3, R_Value=r_value_3)  # -> EPMaterial; plug-in component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
epconstruction = Honeybee_EnergyPlusConstruction(name=concat, layer_1=epnomassmat)  # -> EPConstruction; plug-in component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
epconstruction_2 = Honeybee_EnergyPlusConstruction(name=concat_2, layer_1=epnomassmat_2)  # -> EPConstruction; plug-in component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
epconstruction_3 = Honeybee_EnergyPlusConstruction(name=concat_3, layer_1=epnomassmat_3)  # -> EPConstruction; plug-in component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

perimeter_depth = Slider(3, range=3..10)
floor_height = Slider(3, range=3..5)
# 2. Import Bldg Mass Breps
input_breps = Brep(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)

# ----
# Slab on Ground - without heating
# Slab on Ground - with heating
# Suspended Slab - without heating
# Suspended Slab - with heating
# Other
number_slider = Slider(3, range=0..4)

orientation = Panel("""n
nw
w
sw
s
se
e
ne""")
u_value = Panel("""3
3
3
3
3
3
3
3""")
shgc = Panel("""0.3
0.3
0.3
0.3
0.3
0.3
0.3
0.3""")
concat_4 = Concatenate(FragmentA=orientation, FragmentB="_", FragmentC=u_value, FragmentD="_", FragmentE=shgc)
epwindowmat = Honeybee_EnergyPlusWindowMaterial(name=concat_4, U_Value=u_value, SHGC=shgc, VT=Slider(0.5, range=0..1))  # -> EPMaterial; plug-in component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
epconstruction_4 = Honeybee_EnergyPlusConstruction(name=concat_4, layer_1=epwindowmat)  # -> EPConstruction; plug-in component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

# ----
# Bldg Type: Class 3 - residential
# Class 5 - office
# Class 6 - retail
# Class 9a - healthcare
# Class 9b - assembly building
# Class 9c - aged care
number_slider_2 = Slider(0, range=0..5)

west = Slider(0.15, range=0..0.95)
north = Slider(0.5, range=0..0.95)
sw = Slider(0, range=0..0.95)
south = Slider(0.92, range=0..0.95)
se = Slider(0, range=0..0.95)
east = Slider(0.95, range=0..0.95)
nw = Slider(0, range=0..0.95)
ne = Slider(0, range=0..0.95)

# ----
# City: Canberra
# Sydney
# Darwin
# Brisbane
# Adelaide
# Hobart
# Perth
# Port Headland
# Melbourne
# Richmond RAAF
# Wagga Wagga
number_slider_3 = Slider(8, range=0..10)

# ----
# Roof solar Absorbtance <0.4
# Roof solar Absorbtance >0.4 & <0.6
# Roof solar Absorbtance >0.6
number_slider_4 = Slider(1, range=0..2)

# ----
# 3. Define WWR
num = Number([north, nw, west, sw, south, se, east, ne])

toggle = BooleanToggle(True)
concat_5 = Concatenate(FragmentA="@", FragmentB=floor_height)
split2floors = Honeybee_SplitBuildingMass2Floors(bldgMasses=input_breps, bldgsFlr2FlrHeights=concat_5, runIt=toggle)  # -> readMe, flatten(splitBldgFloors); plug-in component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
split2zone = Honeybee_SplitFloor2ThermalZones(bldgFloors=flatten(split2floors.splitBldgFloors), perimeterZoneDepth=perimeter_depth, runIt=toggle)  # -> readMe, splitBldgZones; plug-in component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
lng = ListLength(List=split2zone.splitBldgZones)
series = Series(Start=0, Step=1, Count=lng)
int = Integer(series)
concat_6 = Concatenate(FragmentA="Room", FragmentB=int)
mass2zone = Honeybee_Masses2Zones(zoneMasses=flatten(split2zone.splitBldgZones), zoneNames=concat_6, maxRoofAngle=30, createHBZones=toggle)  # -> readMe, HBZones; plug-in component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
solveadjc = Honeybee_SolveAdjacencies(HBZones=flatten(mass2zone.HBZones), removeCurrentAdjc=False, findAdjc=toggle)  # -> readMe, HBZonesWADJ; plug-in component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
glazingcreator = Honeybee_GlazingBasedOnRatio(HBObjects=solveadjc.HBZonesWADJ, glzRatio=num, breakUpWindow=Toggle(False), runIt=toggle)  # -> readMe, HBObjWGLZ; plug-in component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

# ----
# 4. Define Proposed Materials
# Opaque Materials
# Glazing
toggle_2 = BooleanToggle(True)
addtoeplibrary = Honeybee_AddToEnergyPlusLibrary(
    EPObject=[epconstruction, epconstruction_3, epconstruction_2, epconstruction_4],
    addToProjectLib=toggle_2,
    overwrite=toggle_2)  # -> flatten(readMe); plug-in component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
panel = Panel(addtoeplibrary)
concat_7 = Concatenate(FragmentA="Roof_R", FragmentB=r_value_3)
concat_8 = Concatenate(FragmentA="Floor_R", FragmentB=r_value)
concat_9 = Concatenate(FragmentA="Wall_R", FragmentB=r_value_2)

# ----
# Shade Projection (P)
north_2 = Slider(0, range=0..3)
west_2 = Slider(0, range=0..3)
sw_2 = Slider(0, range=0..3)
south_2 = Slider(1.5, range=0..3)
se_2 = Slider(0, range=0..3)
east_2 = Slider(1.5, range=0..3)
nw_2 = Slider(0, range=0..3)
ne_2 = Slider(0, range=0..3)
num_2 = Number([north_2, nw_2, west_2, sw_2, south_2, se_2, east_2, ne_2])

# ----
# Shade Height Above Glass (G)
north_3 = Slider(0.2, range=0..3)
west_3 = Slider(0, range=0..3)
sw_3 = Slider(0, range=0..3)
south_3 = Slider(0.4, range=0..3)
se_3 = Slider(0, range=0..3)
east_3 = Slider(0.4, range=0..3)
nw_3 = Slider(0, range=0..3)
ne_3 = Slider(0, range=0..3)
num_3 = Number([north_3, nw_3, west_3, sw_3, south_3, se_3, east_3, ne_3])

# ----
# 5. Define Shading
number_slider_5 = Slider(1, range=0..2)

txt = Text(num_2)
replace = ReplaceMembers(Set=txt, Find="0.0", Replace="0.001")
decomposebytype = Honeybee_DecomposeBasedOnType(HBZone=glazingcreator.HBObjWGLZ)  # -> flatten(walls), interiorWalls, airWalls, windows, interiorWindows, skylights, roofs, ceilings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; plug-in component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
epwindowshades = Honeybee_EnergyPlusWindowShadeGenerator(
    HBObjects=flatten(glazingcreator.HBObjWGLZ),
    shadeType="0",
    interiorOrExter=Toggle(False),
    depth=replace,
    numOfShds=number_slider_5,
    horOrVertical=Toggle(True),
    runIt=Toggle(True))  # -> readMe, port, HBObjWShades, port_2, windowBreps, shadeBreps, port_3, shadeMatName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; plug-in component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

# ----
# Class 3 - residential
# Class 5 - office
# Class 6 - retail
# Class 9a - healthcare
# Class 9b - assembly building
# Class 9c - aged care
num_4 = Number(number_slider_2)
panel_2 = Panel("""4.5
0.80
0.80
0.80
0.80
0.80""")
panel_3 = Panel("""4.5
2.5
2.5
2.5
2.5
2.5""")
panel_4 = Panel("""2
6
6
6
6
6""")
panel_5 = Panel("""PTHP - Residential
VAV c/w PFP Boxes
VAV c/w PFP Boxes
VAV c/w PFP Boxes
VAV c/w PFP Boxes
VAV c/w PFP Boxes""")
item = ListItem(List=panel_5, Index=num_4, Wrap=True)
item_2 = ListItem(List=panel_4, Index=num_4, Wrap=True)
item_3 = ListItem(List=panel_2, Index=num_4, Wrap=True)
item_4 = ListItem(List=panel_3, Index=num_4, Wrap=True)
coolingdetails = Honeybee_HVACCoolingDetails(coolingCOP=item_4)  # -> coolingDetails; plug-in component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
heatingdetails = Honeybee_HVACHeatingDetails(heatingEffOrCOP=item_3)  # -> heatingDetails; plug-in component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
concat_10 = Concatenate(FragmentA="Cooling COP: ", FragmentB=item_4)
concat_11 = Concatenate(FragmentA="Heating Efficiency: ", FragmentB=item_3)
panel_6 = Panel(["HVAC System Description:", item, concat_10, concat_11])
hvacsystem = Honeybee_AssignHVACSystem(
    HBZones=flatten(glazingcreator.HBObjWGLZ),
    HVACSystems=item_2,
    heatingDetails=heatingdetails,
    coolingDetails=coolingdetails)  # -> readMe, HBZones; plug-in component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

heating_set_back_temperature = Slider(5, range=0..30)
# 6. Generate
# Schedules
heating_set_point = Slider(20, range=15..30)

cooling_set_point = Slider(24, range=15..50)
cooling_set_back_temperature = Slider(50, range=15..50)

ach_plant_not_operating = Slider(1.5, range=0..5)
ach_plant_operating = Slider(1, range=0..5)

floor_to_floor_height = Slider(2.7, range=0..10)

cluster = Cluster(
    shadeheight=num_3,
    shade_depths=replace,
    window_breps=epwindowshades.windowBreps,
    shade_breps=epwindowshades.shadeBreps,
    numofshades=number_slider_5,
    windowtowallratio=num,
    walls=decomposebytype.walls,
    cityindex=number_slider_3,
    bldgprogramindex=number_slider_2)  # -> constructionnames_2, uvalues_2, shgc_2, shadeasbrep_2
toggle_3 = BooleanToggle(False)
panel_7 = Panel("""ABCB Section J
Hour
(time of day)
1 (12-1 am)
2 (1-2 am)
3 (2-3 am)
4 (3-4 am)
5 (4-5 am)
6 (5-6 am)
7 (6-7 am)
8 (7-8 am)
9 (8-9 am)
10 (9-10 am)
11 (10-11 am
12 (11-12 pm)
13 (12-1 pm)
14 (1-2 pm)
15 (2-3 pm)
16 (3-4 pm)
17 (4-5 pm)
18 (5-6 pm)
19 (6-7 pm)
20 (7-8 pm)
21 (8-9 pm) 
22 (9-10 pm)
23 (10-11pm)
24 (11-12 am)
Class 3 & Class 9c Building (Residential or Age Care)
Occupancy schedule
wk
0.85
0.85
0.85
0.85
0.85
0.85
0.85
0.8
0.5
0.1
0.1
0.1
0.1
0.1
0.1
0.1
0.5
0.5
0.7
0.7
0.8
0.85
0.85
0.85
<null>
Lighting schedule
wk
0.05
0.05
0.05
0.05
0.05
0.25
0.8
0.8
0.5
0.2
0.2
0.2
0.2
0.2
0.2
0.2
0.2
0.5
0.5
0.5
0.5
0.5
0.5
0.05
<null>
HVAC schedule
wk
1
1
1
1
1
1
1
1
1
0
0
0
0
0
0
0
1
1
1
1
1
1
1
1
Class 5, Class 8, Class 9a Building (Office, Laboratory, Clinic)
Occupancy schedule
wk
0
0
0
0
0
0
0
0.15
0.6
1
1
1
1
1
1
1
1
0.5
0.15
0.05
0.05
0
0
0
<null>
<null>
w/e 1
0
0
0
0
0
0
0
0
0
0
0
0
0
0
0
0
0
0
0
0
0
0
0
0
<null>
Lighting schedule
wk
0.1
0.1
0.1
0.1
0.1
0.1
0.1
0.4
0.8
1
1
1
1
1
1
1
1
0.8
0.6
0.4
0.2
0.1
0.1
0.1
<null>
<null>
w/e 1
0.1
0.1
0.1
0.1
0.1
0.1
0.1
0.1
0.1
0.1
0.1
0.1
0.1
0.1
0.1
0.1
0.1
0.1
0.1
0.1
0.1
0.1
0.1
0.1
<null>
HVAC schedule
wk
0
0
0
0
0
0
0
1
1
1
1
1
1
1
1
1
1
1
0
0
0
0
0
0
<null>
<null>
w/e 1
0
0
0
0
0
0
0
0
0
0
0
0
0
0
0
0
0
0
0
0
0
0
0
0
<null>
Appliances and Equipment Schedule
wk
0.1
0.1
0.1
0.1
0.1
0.1
0.1
0.25
0.7
1
1
1
1
1
1
1
1
0.6
0.25
0.15
0.15
0.1
0.1
0.1
Class 6 Building (Shopping Centre)
Occupancy schedule
wk
0
0
0
0
0
0
0
0.1
0.2
0.2
0.15
0.25
0.25
0.15
0.15
0.15
0.15
0.05
0.05
0
0
0
0
0
<null>
Lighting schedule
wk
0.1
0.1
0.1
0.1
0.1
0.1
0.1
1
1
1
1
1
1
1
1
1
1
1
1
0.1
0.1
0.1
0.1
0.1
<null>
HVAC schedule
wk
0
0
0
0
0
0
0
1
1
1
1
1
1
1
1
1
1
1
0
0
0
0
0
0
<null>
Appliance and Equipment schedule
wk
0.1
0.1
0.1
0.1
0.1
0.1
0.1
0.7
0.7
0.7
0.7
0.7
0.7
0.7
0.7
0.7
0.7
0.7
0.7
0.1
0.1
0.1
0.1
0.1
Class 9a Building (Ward Area - Hospitals)
Occupancy Schedule
wk
0.85
0.85
0.85
0.85
0.85
0.85
0.85
0.85
0.85
0.85
0.85
0.85
0.85
0.85
0.85
0.85
0.85
0.85
0.85
0.85
0.85
0.85
0.85
0.85
<null>
Lighting schedule
wk
0.05
0.05
0.05
0.05
0.05
0.25
0.8
0.8
0.5
0.2
0.2
0.2
0.2
0.2
0.2
0.2
0.2
0.5
0.5
0.5
0.5
0.5
0.5
0.05
<null>
HVAC schedule
wk
1
1
1
1
1
1
1
1
1
1
1
1
1
1
1
1
1
1
1
1
1
1
1
1
Class 9b (School)
Occupancy schedule
wk
0
0
0
0
0
0
0
0.05
0.75
0.9
0.9
0.9
0.5
0.5
0.9
0.7
0.5
0.2
0.2
0.2
0.1
0.05
0.05
0.05
<null>
<null>
w/e 1
0
0
0
0
0
0
0
0
0
0
0
0
0
0
0
0
0
0
0
0
0
0
0
0
<null>
Lighting schedule
wk
0.05
0.05
0.05
0.05
0.05
0.05
0.05
0.3
0.85
0.95
0.95
0.95
0.8
0.8
0.95
0.9
0.7
0.2
0.2
0.2
0.1
0.05
0.05
0.05
<null>
<null>
w/e 1
0.05
0.05
0.05
0.05
0.05
0.05
0.05
0.05
0.05
0.05
0.05
0.05
0.05
0.05
0.05
0.05
0.05
0.05
0.05
0.05
0.05
0.05
0.05
0.05
<null>
HVAC schedule
wk
0
0
0
0
0
0
0
1
1
1
1
1
1
1
1
1
1
0
0
0
0
0
0
0
<null>
<null>
w/e 1
0
0
0
0
0
0
0
0
0
0
0
0
0
0
0
0
0
0
0
0
0
0
0
0
<null>
Appliances and Equipment Schedule
wk
0.05
0.05
0.05
0.05
0.05
0.05
0.05
0.3
0.85
0.95
0.95
0.95
0.7
0.7
0.95
0.8
0.6
0.2
0.2
0.2
0.1
0.05
0.05
0.05
<null>
<null>
w/e 1
0.05
0.05
0.05
0.05
0.05
0.05
0.05
0.05
0.05
0.05
0.05
0.05
0.05
0.05
0.05
0.05
0.05
0.05
0.05
0.05
0.05
0.05
0.05
0.05""")
partition = PartitionList(List=panel_7, Size="27")

u_value_2 = Data(cluster.uvalues_2)
lng_2 = ListLength(List=u_value_2)
larger = LargerThan(FirstNumber=u_value_2, SecondNumber="5.8")  # -> LargerThan, OrEqualTo
series_2 = Series(Start=0, Step=1, Count=lng_2)
dispatch = Dispatch(List=series_2, DispatchPattern=larger.LargerThan)  # -> ListA, ListB
replace_2 = ReplaceItems(List=u_value_2, Item="5.8", Indices=dispatch.ListA, Wrap=False)
epwindowmat_2 = Honeybee_EnergyPlusWindowMaterial(name=cluster.constructionnames_2, U_Value=replace_2, SHGC=cluster.shgc_2, VT="0.5")  # -> EPMaterial; plug-in component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
epconstruction_5 = Honeybee_EnergyPlusConstruction(name=cluster.constructionnames_2, layer_1=epwindowmat_2)  # -> EPConstruction; plug-in component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
toggle_4 = BooleanToggle(True)
addtoeplibrary_2 = Honeybee_AddToEnergyPlusLibrary(EPObject=epconstruction_5, addToProjectLib=toggle_4, overwrite=toggle_4)  # -> simplify(flatten(readMe)); plug-in component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
panel_8 = Panel(addtoeplibrary_2)

# ----
# Reference Buliding Construction
panel_9 = Panel("Roof")
panel_10 = Panel("""4.8
4.2
3.7
3.2""")
panel_11 = Panel("""3.3
2.8
3.8""")
panel_12 = Panel("""1.0
1.25
1.5
1.75
2.0
2.25
2.5
3.5""")
concat_12 = Concatenate(FragmentA="Floor", FragmentB="_R", FragmentC=panel_12)
concat_13 = Concatenate(FragmentA="Wall", FragmentB="_R", FragmentC=panel_11)
concat_14 = Concatenate(FragmentA=panel_9, FragmentB="_R", FragmentC=panel_10)
epnomassmat_4 = Honeybee_EnergyPlusNoMassOpaqueMaterial(name=concat_14, R_Value=panel_10)  # -> EPMaterial; plug-in component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
epnomassmat_5 = Honeybee_EnergyPlusNoMassOpaqueMaterial(name=concat_13, R_Value=panel_11)  # -> EPMaterial; plug-in component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
epnomassmat_6 = Honeybee_EnergyPlusNoMassOpaqueMaterial(name=concat_12, R_Value=panel_12)  # -> EPMaterial; plug-in component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
epconstruction_6 = Honeybee_EnergyPlusConstruction(name=concat_14, layer_1=epnomassmat_4)  # -> EPConstruction; plug-in component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
epconstruction_7 = Honeybee_EnergyPlusConstruction(name=concat_13, layer_1=epnomassmat_5)  # -> EPConstruction; plug-in component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
epconstruction_8 = Honeybee_EnergyPlusConstruction(name=concat_12, layer_1=epnomassmat_6)  # -> EPConstruction; plug-in component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
toggle_5 = BooleanToggle(True)
addtoeplibrary_3 = Honeybee_AddToEnergyPlusLibrary(EPObject=[epconstruction_6, epconstruction_7, epconstruction_8], addToProjectLib=toggle_5, overwrite=toggle_5)  # -> readMe; plug-in component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
panel_13 = Panel(addtoeplibrary_3)

panel_14 = Panel("""0
1
2""")
int_2 = Integer(number_slider_2)
cull_i = CullIndex(List=partition, Indices=panel_14, Wrap=True)  # -> simplify(List)
panel_15 = Panel(int_2)
panel_16 = Panel(cull_i)

panel_17 = Panel("""17
10
14
17
24
17""")
panel_18 = Panel("""17
11
14
17
25
17""")
equip_wknd = ListItem(List=panel_18, Index=int_2, Wrap=True)
equip_wk = ListItem(List=panel_17, Index=int_2, Wrap=True)
path = DataPath(equip_wknd)
path_2 = DataPath(equip_wk)
equip_wk_2 = TreeBranch(Tree=cull_i, Path=path_2, MaintainPaths=True)
equip_wknd_2 = TreeBranch(Tree=cull_i, Path=path, MaintainPaths=True)

panel_19 = Panel("""3
8
13
17
22
3""")
panel_20 = Panel("""3
9
13
17
23
3""")
hvac_wknd = ListItem(List=panel_20, Index=int_2, Wrap=True)
hvac_wk = ListItem(List=panel_19, Index=int_2, Wrap=True)
path_3 = DataPath(hvac_wknd)
path_4 = DataPath(hvac_wk)
hvac_wknd_2 = TreeBranch(Tree=cull_i, Path=path_3, MaintainPaths=True)
hvac_wk_2 = TreeBranch(Tree=cull_i, Path=path_4, MaintainPaths=True)

multiplication = Multiplication(A=hvac_wk_2, B=heating_set_point)
equals = Equality(FirstNumber=multiplication, SecondNumber="0")  # -> Equality, Inequality
sift = SiftPattern(List=multiplication, SiftPattern=equals.Inequality)  # -> Output0, Output1
nullrep = ReplaceNulls(Items=sift.Output1, Replacements=heating_set_back_temperature)  # -> Items, Count

panel_21 = Panel("""2
6
12
16
20
2""")
panel_22 = Panel("""2
7
12
16
21
2""")
light_wknd = ListItem(List=panel_22, Index=int_2, Wrap=True)
light_wk = ListItem(List=panel_21, Index=int_2, Wrap=True)
path_5 = DataPath(light_wknd)
path_6 = DataPath(light_wk)
light_wknd_2 = TreeBranch(Tree=cull_i, Path=path_5, MaintainPaths=True)
light_wk_2 = TreeBranch(Tree=cull_i, Path=path_6, MaintainPaths=True)

multiplication_2 = Multiplication(A=hvac_wk_2, B=cooling_set_point)
equals_2 = Equality(FirstNumber=multiplication_2, SecondNumber="0")  # -> Equality, Inequality
sift_2 = SiftPattern(List=multiplication_2, SiftPattern=equals_2.Inequality)  # -> Output0, Output1
nullrep_2 = ReplaceNulls(Items=sift_2.Output1, Replacements=cooling_set_back_temperature)  # -> Items, Count

multiplication_3 = Multiplication(A=hvac_wknd_2, B=cooling_set_point)
equals_3 = Equality(FirstNumber=multiplication_3, SecondNumber="0")  # -> Equality, Inequality
sift_3 = SiftPattern(List=multiplication_3, SiftPattern=equals_3.Inequality)  # -> Output0, Output1
nullrep_3 = ReplaceNulls(Items=sift_3.Output1, Replacements=cooling_set_back_temperature)  # -> Items, Count

panel_23 = Panel("""1
4
11
15
18
1""")
panel_24 = Panel("""1
5
11
15
19
1""")
occ_wknd = ListItem(List=panel_24, Index=int_2, Wrap=True)
occ_wk = ListItem(List=panel_23, Index=int_2, Wrap=True)
path_7 = DataPath(occ_wknd)
path_8 = DataPath(occ_wk)
occ_wknd_2 = TreeBranch(Tree=cull_i, Path=path_7, MaintainPaths=True)
occ_wk_2 = TreeBranch(Tree=cull_i, Path=path_8, MaintainPaths=True)

multiplication_4 = Multiplication(A=hvac_wknd_2, B=heating_set_point)
equals_4 = Equality(FirstNumber=multiplication_4, SecondNumber="0")  # -> Equality, Inequality
sift_4 = SiftPattern(List=multiplication_4, SiftPattern=equals_4.Inequality)  # -> Output0, Output1
nullrep_4 = ReplaceNulls(Items=sift_4.Output1, Replacements=heating_set_back_temperature)  # -> Items, Count

panel_25 = Panel("""5
4
0
1
4
6
4
0
5
5
3""")
panel_26 = Panel("""0.1
1.25
1
1.25
2
0.1
1.25
1
1.25
2
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""")
item_5 = ListItem(List=panel_25, Index=number_slider_3, Wrap=True)
partition_2 = PartitionList(List=panel_26, Size="5")  # -> simplify(Chunks)
path_9 = DataPath(item_5)
branch = TreeBranch(Tree=partition_2, Path=path_9, MaintainPaths=True)
item_6 = ListItem(List=branch, Index=number_slider, Wrap=True)

panel_27 = Panel("""1
0
0
0
0
2
0
0
1
1
0""")
panel_28 = Panel("""3.2
3.7
4.2
3.2
3.2
3.2
3.7
4.8
4.8
4.8""")
item_7 = ListItem(List=panel_27, Index=number_slider_3, Wrap=True)
partition_3 = PartitionList(List=panel_28, Size="3")  # -> simplify(Chunks)
path_10 = DataPath(item_7)
branch_2 = TreeBranch(Tree=partition_3, Path=path_10, MaintainPaths=True)
item_8 = ListItem(List=branch_2, Index=number_slider_4, Wrap=True)

panel_29 = Panel("""2.8
2.8
3.3
3.3
2.8
2.8
2.8
3.3
2.8
2.8
2.8""")
item_9 = ListItem(List=panel_29, Index=number_slider_3, Wrap=True)

# ----
# Walls
panel_30 = Panel("Wall_R")
concat_15 = Concatenate(FragmentA=panel_30, FragmentB=item_9)

windowconstructions = Data(simplify(graft(concat_4)))
roofconstructions = Data(concat_7)
wallconstructions = Data(concat_9)
floorconstructions = Data(concat_8)
windowconstructions_2 = Data(simplify(graft(cluster.constructionnames_2)))
wallconstructions_2 = Data(concat_15)

# ----
# Roof
panel_31 = Panel("Roof_R")
concat_16 = Concatenate(FragmentA=panel_31, FragmentB=item_8)

roofconstructions_2 = Data(concat_16)

# ----
# Floor
panel_32 = Panel("Floor_R")
concat_17 = Concatenate(FragmentA=panel_32, FragmentB=item_6)

floorconstructions_2 = Data(concat_17)

# ----
# in case Cc = 0, make U-value =1
# replace UVal >7.0
panel_33 = Panel("""https://www.energyplus.net/weather-download/southwest_pacific_wmo_region_5/AUS//AUS_ACT.Canberra.Airport.949260_RMY/all
https://www.energyplus.net/weather-download/southwest_pacific_wmo_region_5/AUS//AUS_NSW.Mascot-Sydney.Airport.947670_RMY/all
https://www.energyplus.net/weather-download/southwest_pacific_wmo_region_5/AUS//AUS_NT.Darwin.Airport.941200_RMY/all
https://www.energyplus.net/weather-download/southwest_pacific_wmo_region_5/AUS//AUS_QLD.Brisbane.94578_RMY/all
https://www.energyplus.net/weather-download/southwest_pacific_wmo_region_5/AUS//AUS_SA.Adelaide-Kent.Town.946750_RMY/all
https://www.energyplus.net/weather-download/southwest_pacific_wmo_region_5/AUS//AUS_TAS.Hobart-Ellerslie.Road.949700_RMY/all
https://www.energyplus.net/weather-download/southwest_pacific_wmo_region_5/AUS//AUS_WA.Perth.Airport.946100_RMY/all
https://www.energyplus.net/weather-download/southwest_pacific_wmo_region_5/AUS//AUS_WA.Port.Hedland.Airport.943120_RMY/all
https://www.energyplus.net/weather-download/southwest_pacific_wmo_region_5/AUS//AUS_VIC.Melbourne.948680_RMY/all
https://www.energyplus.net/weather-download/southwest_pacific_wmo_region_5/AUS//AUS_NSW.Richmond.RAAF.957530_RMY/all
https://www.energyplus.net/weather-download/southwest_pacific_wmo_region_5/AUS//AUS_NSW.Wagga.Wagga.949100_RMY/all""")
fixed_eaves_shading_systems = Brep(cluster.shadeasbrep_2)
hb_epcontextsrf = HoneybeeEPContextSurfaces(shdSurfaces=flatten(fixed_eaves_shading_systems))  # -> HBContext; inputs shdSurfaces: list of Brep, justBoundingBox: Boolean
# ---------- hb_epcontextsrf: Python ----------
"""
prepare shading/context geometries

    Args:
        northVectorOrRotation: A vector that shows North or a number that shows
                               the rotation of the North from the Y axis
        bldgMasses: List of closed Breps as thermal zones.
    Returns:
        report: ...
        thermalZones: Thermal zone's geometries for visualiza
"""

ghenv.Component.Name = 'Honeybee EP context Surfaces'
ghenv.Component.NickName = 'HB_EPContextSrf'
ghenv.Component.Message = 'VER 0.0.63\nJAN_20_2018'
ghenv.Component.IconDisplayMode = ghenv.Component.IconDisplayMode.application
ghenv.Component.Category = "Honeybee"
ghenv.Component.SubCategory = "10 | Energy | Energy"
#compatibleHBVersion = VER 0.0.57\nNOV_04_2016
#compatibleLBVersion = VER 0.0.59\nFEB_01_2015
ghenv.Component.AdditionalHelpFromDocStrings = "2"

import rhinoscriptsyntax as rs
import Rhino as rc
import scriptcontext as sc
import os
import System
import Grasshopper.Kernel as gh
import uuid

tolerance = sc.doc.ModelAbsoluteTolerance
import math


def main(shdSurfaces, EPTransSchedule, meshingSettings, justBoundingBox):
    
    # import the classes
    if sc.sticky.has_key('honeybee_release'):

        try:
            if not sc.sticky['honeybee_release'].isCompatible(ghenv.Component): return -1
            if sc.sticky['honeybee_release'].isInputMissing(ghenv.Component): return -1
        except:
            warning = "You need a newer version of Honeybee to use this compoent." + \
            " Use updateHoneybee component to update userObjects.\n" + \
            "If you have already updated userObjects drag Honeybee_Honeybee component " + \
            "into canvas and try again."
            w = gh.GH_RuntimeMessageLevel.Warning
            ghenv.Component.AddRuntimeMessage(w, warning)
            return -1
        
        # don't customize this part
        hb_EPSrf = sc.sticky["honeybee_EPSurface"]
        hb_EPSHDSurface = sc.sticky["honeybee_EPShdSurface"]
        hb_RADMaterialAUX = sc.sticky["honeybee_RADMaterialAUX"]
        hb_EPObjectsAux = sc.sticky["honeybee_EPObjectsAUX"]()
        HBScheduleList = sc.sticky["honeybee_ScheduleLib"].keys()

        ########################################################################
        #----------------------------------------------------------------------#
        shdBreps = []
        # create bounding box of shading geometries
        if justBoundingBox:
            for brep in shdSurfaces:
                if brep.Faces.Count>1 or not brep.Faces[0].IsPlanar(sc.doc.ModelAbsoluteTolerance):
                    shdBreps.append(brep.GetBoundingBox(True).ToBrep())
                else:
                    shdBreps.append(brep)
        else:
            shdBreps = shdSurfaces
        
        shadingClasses = []
        shadingMeshPreview = []
        
        if meshingSettings == None:
            mp = rc.Geometry.MeshingParameters.Minimal
            mp.SimplePlanes = True
        else:
            mp = meshingSettings
        
        def getRadMaterialName(radMaterial):
            nameStr = radMaterial.split(" ")[2]
            name =  nameStr.split("\n")[0]
            return name
        
        for brepCount, brep in enumerate(shdBreps):
            if brep != None:
                isPlanar = True
                # check planarity
                for face in brep.Faces:
                    if not face.IsPlanar(tolerance):
                        isPlanar = False
                        break
                
                shadingBreps = []
                if not isPlanar:
                    meshArray = rc.Geometry.Mesh.CreateFromBrep(brep, mp)
                    for mesh in meshArray:
                        for meshFace in range(mesh.Faces.Count):
                            vertices = list(mesh.Faces.GetFaceVertices(meshFace))[1:]
                            vertices = vertices + [sc.doc.ModelAbsoluteTolerance]
                            # create the brep from mesh
                            shdBrep = rc.Geometry.Brep.CreateFromCornerPoints(*vertices)
                            shadingBreps.append(shdBrep)
                else:
                    for face in brep.Faces:
                        shadingBreps.append(face.DuplicateFace(False))
                
                for faceCount, shdBrep in enumerate(shadingBreps):
                        thisShading = hb_EPSHDSurface(shdBrep, 1000*brepCount + faceCount, 'shdSrf_' + `brepCount` + '_' + `faceCount` + "_" + str(uuid.uuid4()))
                        
                        # add transmittance schedule if any
                        if EPTransSchedule!=None:
                            schedule= EPTransSchedule.upper()
                            if schedule!=None and not schedule.lower().endswith(".csv") and schedule not in HBScheduleList:
                                msg = "Cannot find " + schedule + " in Honeybee schedule library."
                                print msg
                                ghenv.Component.AddRuntimeMessage(gh.GH_RuntimeMessageLevel.Warning, msg)
                                return -1
                            elif schedule!=None and schedule.lower().endswith(".csv"):
                                # check if csv file is existed
                                if not os.path.isfile(schedule):
                                    msg = "Cannot find the shchedule file: " + schedule
                                    print msg
                                    ghenv.Component.AddRuntimeMessage(gh.GH_RuntimeMessageLevel.Warning, msg)
                                    return -1
                            
                            thisShading.TransmittanceSCH = schedule
                        
                        # add the Rad Material if any
                        if RADMaterial!=None:
                            # if it is just the name of the material make sure it is already defined
                            if len(RADMaterial.split(" ")) == 1:
                                # if the material is not in the library add it to the library
                                if not hb_RADMaterialAUX.isMatrialExistInLibrary(RADMaterial):
                                    warningMsg = "Can't find " + RADMaterial + " in RAD Material Library.\n" + \
                                                "Add the material to the library and try again."
                                    ghenv.Component.AddRuntimeMessage(gh.GH_RuntimeMessageLevel.Warning, warningMsg)
                                    return
                                
                                try:
                                    thisShading.setRADMaterial(RADMaterial)
                                except Exception, e:
                                    print e
                                    warningMsg = "You are using an old version of Honeybee_Honeybee! Update your files and try again."
                                    print warningMsg
                                    ghenv.Component.AddRuntimeMessage(gh.GH_RuntimeMessageLevel.Warning, warningMsg)
                                    return
                                
                                addedToLib = True
                            else:
                                
                                # try to add the material to the library
                                addedToLib, thisShading.RadMaterial = hb_RADMaterialAUX.analyseRadMaterials(RADMaterial, True)
                                
                            if addedToLib==False:
                                warningMsg = "Failed to add " + RADMaterial + " to the Library."
                                ghenv.Component.AddRuntimeMessage(gh.GH_RuntimeMessageLevel.Warning, warningMsg)
                                return
                        
                        # add shading to the list
                        shadingClasses.append(thisShading)
                
        # add to the hive
        hb_hive = sc.sticky["honeybee_Hive"]()
        HBContext  = hb_hive.addToHoneybeeHive(shadingClasses, ghenv.Component)
        return HBContext
        ################################################################################################
    else:
        print "You should first let Honeybee to fly..."
        w = gh.GH_RuntimeMessageLevel.Warning
        ghenv.Component.AddRuntimeMessage(w, "You should first let Honeybee to fly...")
        return -1
        

if _shdSurfaces and _shdSurfaces[0]!=None:
    # add cleaning function
    result= main(_shdSurfaces, EPTransSchedule_, meshingSettings_, justBoundingBox_)
    
    if result != -1: HBContext = result
# ---------- end hb_epcontextsrf ----------
item_10 = ListItem(List=panel_33, Index=number_slider_3, Wrap=True)
epw_stat = Ladybug_OpenEPWAndSTATWeatherFiles(weatherFileURL=item_10)  # -> epwFile, statFile; plug-in component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

epoutput = Honeybee_GenerateEPOutput(
    zoneEnergyUse=Toggle(True),
    zoneGainsAndLosses="False",
    zoneComfortMetrics="False",
    surfaceTempAnalysis="False",
    timestep="monthly")  # -> report, flatten(simulationOutputs); plug-in component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

toggle_6 = BooleanToggle(False)
panel_34 = Panel(panel_6)

# ----
# Adaiabatic Pesudo Wall Type
panel_35 = Panel("Wall")
concat_18 = Concatenate(FragmentA=panel_35, FragmentB="_R", FragmentC="100")
txt_2 = Text(concat_18)
toggle_7 = BooleanToggle(True)

epnomassmat_7 = Honeybee_EnergyPlusNoMassOpaqueMaterial(name=txt_2, roughness="MediumRough", R_Value="100")  # -> EPMaterial; plug-in component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

epconstruction_9 = Honeybee_EnergyPlusConstruction(name=txt_2, layer_1=epnomassmat_7)  # -> EPConstruction; plug-in component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
addtoeplibrary_4 = Honeybee_AddToEnergyPlusLibrary(EPObject=epconstruction_9, addToProjectLib=toggle_7, overwrite=toggle_7)  # -> readMe; plug-in component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
panel_36 = Panel(addtoeplibrary_4)

# ----
# Class 3 - residential
# Class 5 - office
# Class 6 - retail
# Class 9a - healthcare
# Class 9b - assembly building
# Class 9c - aged care
max = Maximum(A=ach_plant_operating, B=ach_plant_not_operating)
division = Division(A=ach_plant_operating, B=max)
division_2 = Division(A=ach_plant_not_operating, B=max)
# Define Schedules and Loads
panel_37 = Panel("""Class_3_
Class_5_
Class_6_
Class_9a_
Class_9b_
Class_9c_""")
item_11 = ListItem(List=panel_37, Index=int_2, Wrap=True)
series_3 = Series(Start="160", Step="0", Count="7")
concat_19 = Concatenate(FragmentA=item_11, FragmentB="Activity")
concat_20 = Concatenate(FragmentA=item_11, FragmentB="Infil")
concat_21 = Concatenate(FragmentA=item_11, FragmentB="Equip")
concat_22 = Concatenate(FragmentA=item_11, FragmentB="HVAC")
concat_23 = Concatenate(FragmentA=item_11, FragmentB="CoolSetPt")
concat_24 = Concatenate(FragmentA=item_11, FragmentB="Light")
concat_25 = Concatenate(FragmentA=item_11, FragmentB="Occ")
concat_26 = Concatenate(FragmentA=item_11, FragmentB="HeatSetPt")
annualschedule = Honeybee_AnnualSchedule(
    sun=nullrep_3.Items,
    mon=nullrep_2.Items,
    tue=nullrep_2.Items,
    wed=nullrep_2.Items,
    thu=nullrep_2.Items,
    fri=nullrep_2.Items,
    sat=nullrep_3.Items,
    scheduleName=concat_23,
    runIt=toggle_3)  # -> readMe, port, schedule, port_2, weekSched, schedIDFText; plug-in component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
annualschedule_2 = Honeybee_AnnualSchedule(
    sun=equip_wknd_2,
    mon=equip_wk_2,
    tue=equip_wk_2,
    wed=equip_wk_2,
    thu=equip_wk_2,
    fri=equip_wk_2,
    sat=equip_wknd_2,
    scheduleName=concat_21,
    runIt=toggle_3)  # -> readMe, port, schedule, port_2, weekSched, schedIDFText; plug-in component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
annualschedule_3 = Honeybee_AnnualSchedule(
    sun=nullrep_4.Items,
    mon=nullrep.Items,
    tue=nullrep.Items,
    wed=nullrep.Items,
    thu=nullrep.Items,
    fri=nullrep.Items,
    sat=nullrep_4.Items,
    scheduleName=concat_26,
    runIt=toggle_3)  # -> readMe, port, schedule, port_2, weekSched, schedIDFText; plug-in component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
annualschedule_4 = Honeybee_AnnualSchedule(
    sun=light_wknd_2,
    mon=light_wk_2,
    tue=light_wk_2,
    wed=light_wk_2,
    thu=light_wk_2,
    fri=light_wk_2,
    sat=light_wknd_2,
    scheduleName=concat_24,
    runIt=toggle_3)  # -> readMe, port, schedule, port_2, weekSched, schedIDFText; plug-in component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
annualschedule_5 = Honeybee_AnnualSchedule(
    sun=hvac_wknd_2,
    mon=hvac_wk_2,
    tue=hvac_wk_2,
    wed=hvac_wk_2,
    thu=hvac_wk_2,
    fri=hvac_wk_2,
    sat=hvac_wknd_2,
    scheduleName=concat_22,
    runIt=toggle_3)  # -> readMe, port, schedule, port_2, weekSched, schedIDFText; plug-in component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
annualschedule_6 = Honeybee_AnnualSchedule(
    sun=occ_wknd_2,
    mon=occ_wk_2,
    tue=occ_wk_2,
    wed=occ_wk_2,
    thu=occ_wk_2,
    fri=occ_wk_2,
    sat=occ_wknd_2,
    scheduleName=concat_25,
    runIt=toggle_3)  # -> readMe, port, schedule, port_2, weekSched, schedIDFText; plug-in component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
annualschedule_7 = Honeybee_AnnualSchedule(
    sun=series_3,
    mon=series_3,
    tue=series_3,
    wed=series_3,
    thu=series_3,
    fri=series_3,
    sat=series_3,
    scheduleName=concat_19,
    schedTypeLimits="ActivityLevel",
    runIt=toggle_3)  # -> readMe, port, schedule, port_2, weekSched, schedIDFText; plug-in component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

multiplication_5 = Multiplication(A=hvac_wk_2, B=division)
equals_5 = Equality(FirstNumber=multiplication_5, SecondNumber="0")  # -> Equality, Inequality
sift_5 = SiftPattern(List=multiplication_5, SiftPattern=equals_5.Inequality)  # -> Output0, Output1
nullrep_5 = ReplaceNulls(Items=sift_5.Output1, Replacements=division_2)  # -> Items, Count

multiplication_6 = Multiplication(A=hvac_wknd_2, B=division)
equals_6 = Equality(FirstNumber=multiplication_6, SecondNumber="0")  # -> Equality, Inequality
sift_6 = SiftPattern(List=multiplication_6, SiftPattern=equals_6.Inequality)  # -> Output0, Output1
nullrep_6 = ReplaceNulls(Items=sift_6.Output1, Replacements=division_2)  # -> Items, Count

annualschedule_8 = Honeybee_AnnualSchedule(
    sun=nullrep_6.Items,
    mon=nullrep_5.Items,
    tue=nullrep_5.Items,
    wed=nullrep_5.Items,
    thu=nullrep_5.Items,
    fri=nullrep_5.Items,
    sat=nullrep_6.Items,
    scheduleName=concat_20,
    runIt=toggle_3)  # -> readMe, port, schedule, port_2, weekSched, schedIDFText; plug-in component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

# ----
# Class 3 - residential
# Class 5 - office
# Class 6 - retail
# Class 9a - healthcare
# Class 9b - assembly building
# Class 9c - aged care
setepzoneschedules = Honeybee_SetEnergyPlusZoneSchedules(
    HBZones=hvacsystem.HBZones,
    occupancySchedules=annualschedule_6.schedule,
    occupancyActivitySchs=annualschedule_7.schedule,
    heatingSetPtSchedules=annualschedule_3.schedule,
    coolingSetPtSchedules=annualschedule.schedule,
    lightingSchedules=annualschedule_4.schedule,
    equipmentSchedules=annualschedule_2.schedule,
    infiltrationSchedules=annualschedule_8.schedule,
    ventilationSchedules=annualschedule_5.schedule)  # -> schedules, simplify(HBZones); plug-in component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
int_3 = Integer(number_slider_2)
panel_38 = Panel("""20
10
5
10
2
10""")
panel_39 = Panel("""5
9
22
10
10
7""")
panel_40 = Panel("""5
15
5
15
5
5""")
division_3 = Division(A=floor_to_floor_height, B="3600")
item_12 = ListItem(List=panel_40, Index=int_3, Wrap=True)
item_13 = ListItem(List=panel_39, Index=int_3, Wrap=True)
item_14 = ListItem(List=panel_38, Index=int_3, Wrap=True)
division_4 = Division(A="1", B=item_14)
setepzoneloads = Honeybee_SetEnergyPlusZoneLoads(
    HBZones=setepzoneschedules.HBZones,
    equipmentLoadPerArea=item_12,
    infiltrationRatePerArea=division_3,
    lightingDensityPerArea=item_13,
    numOfPeoplePerArea=division_4,
    ventilationPerArea="0",
    ventilationPerPerson="0.075")  # -> loads, HBZones; plug-in component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
separatezonesbyorientation = Honeybee_SeparateZonesByOrientation(HBZones=flatten(setepzoneloads.HBZones), onlyWGlz=Toggle(True))  # -> orientations, HBZones; plug-in component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
perimetercore = Honeybee_PerimeterCoreZoning(HBZones=flatten(separatezonesbyorientation.HBZones))  # -> perimeters, interiors; plug-in component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

decomposebytype_2 = Honeybee_DecomposeBasedOnType(HBZone=perimetercore.perimeters)  # -> flatten(walls), interiorWalls, airWalls, windows, interiorWindows, skylights, roofs, ceilings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; plug-in component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
cluster_2 = Cluster_2(walls=decomposebytype_2.walls, honeybeezones=perimetercore.perimeters)
honeybeezones = Brep(cluster_2)
honeybeezones_2 = Brep(cluster_2)

series_4 = Series(Start=0, Step=1, Count="8")
path_11 = DataPath(series_4)
branch_3 = TreeBranch(Tree=windowconstructions_2, Path=path_11, MaintainPaths=True)
setepzonecnstr = Honeybee_SetEPZoneConstruction(HBZones=honeybeezones_2, windowEPConstruction=branch_3)  # -> simplify(modifiedHBZones); plug-in component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
clean = CleanTree(RemoveNulls=True, RemoveInvalid=True, RemoveEmpty=False, Tree=flatten([setepzonecnstr, perimetercore.interiors]))
setepzonecnstr_2 = Honeybee_SetEPZoneConstruction(
    HBZones=flatten(clean),
    wallEPConstruction=wallconstructions_2,
    roofEPConstruction=roofconstructions_2,
    floorEPConstruction=floorconstructions_2)  # -> simplify(modifiedHBZones); plug-in component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
toggle_8 = BooleanToggle(False)
makeadiabaticbytype = Honeybee_MakeAdiabaticByType(HBZones=setepzonecnstr_2, roofs=Toggle(False), exposedFloors=toggle_8, groundFloors=toggle_8)  # -> HBZones; plug-in component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
setepzoneintcnstr = Honeybee_SetEPZoneInteriorConstruction(HBZones=makeadiabaticbytype, intWallEPConstruction="air wall")  # -> simplify(modifiedHBZones); plug-in component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

setepzonecnstr_3 = Honeybee_SetEPZoneConstruction(HBZones=honeybeezones, windowEPConstruction=windowconstructions)  # -> simplify(modifiedHBZones); plug-in component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
clean_2 = CleanTree(RemoveNulls=True, RemoveInvalid=True, RemoveEmpty=False, Tree=flatten([setepzonecnstr_3, perimetercore.interiors]))
setepzonecnstr_4 = Honeybee_SetEPZoneConstruction(
    HBZones=flatten(clean_2),
    wallEPConstruction=wallconstructions,
    roofEPConstruction=roofconstructions,
    floorEPConstruction=floorconstructions)  # -> simplify(modifiedHBZones); plug-in component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
toggle_9 = BooleanToggle(False)
makeadiabaticbytype_2 = Honeybee_MakeAdiabaticByType(HBZones=setepzonecnstr_4, roofs=Toggle(False), exposedFloors=toggle_9, groundFloors=toggle_9)  # -> HBZones; plug-in component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
setepzoneintcnstr_2 = Honeybee_SetEPZoneInteriorConstruction(HBZones=makeadiabaticbytype_2, intWallEPConstruction="air wall")  # -> simplify(modifiedHBZones); plug-in component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

# ----
# preview the geometry
decomposebybc = Honeybee_DecomposeBasedOnBoundaryCondition(HBZone=setepzoneintcnstr)  # -> outdoors, surface, adiabatic, ground; plug-in component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
decomposebytype_3 = Honeybee_DecomposeBasedOnType(HBZone=setepzoneintcnstr)  # -> walls, interiorWalls, airWalls, windows, interiorWindows, skylights, roofs, ceilings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; plug-in component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
preview = CustomPreview(Geometry=decomposebybc.adiabatic, Shader=ColourSwatch(SwatchColor=RGB(10, 10, 10)))
preview_2 = CustomPreview(Geometry=decomposebytype_3.interiorWalls, Shader=ColourSwatch(SwatchColor=RGB(205, 210, 212)))
preview_3 = CustomPreview(Geometry=decomposebytype_3.walls, Shader=ColourSwatch(SwatchColor=RGB(135, 35, 35)))
preview_4 = CustomPreview(Geometry=decomposebytype_3.airWalls, Shader=ColourSwatch(SwatchColor=RGB(178, 232, 255)))
preview_5 = CustomPreview(Geometry=decomposebytype_3.roofs, Shader=ColourSwatch(SwatchColor=RGB(135, 135, 135)))
preview_6 = CustomPreview(
    Geometry=[decomposebytype_3.groundFloors, decomposebytype_3.floors, decomposebytype_3.exposedFloors],
    Shader=ColourSwatch(SwatchColor=RGB(33, 33, 33)))

preview_7 = CustomPreview(Geometry=decomposebytype_3.windows, Shader=ColourSwatch(SwatchColor=RGBA(178, 232, 255, 64)))

# ----
# 7. Calculate Results!!!
# set analysis directory
panel_41 = Panel("C:\ladybug")
exporttoopenstudio = Honeybee_ExportToOpenStudio(
    epwWeatherFile=epw_stat.epwFile,
    HBZones=flatten(setepzoneintcnstr),
    HBContext=flatten(hb_epcontextsrf),
    simulationOutputs=flatten(epoutput.simulationOutputs),
    writeOSM=toggle_6,
    runSimulation=toggle_6,
    fileName="reference",
    workingDir=panel_41)  # -> readMe, osmFileAddress, idfFileAddress, resultFileAddress, eioFileAddress, rddFileAddress, htmlReport, studyFolder, model; plug-in component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

# ----
# 8. ANALYSE RESULTS
readepresult = Honeybee_ReadEPResult(resultFileAddress=exporttoopenstudio.resultFileAddress)  # -> totalThermalLoad, thermalLoadBalance, cooling, heating, electricLight, electricEquip, fanElectric, pumpElectric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; plug-in component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
strnum = Ladybug_SeparateData(inputList=flatten(readepresult.cooling))  # -> numbers, strings; plug-in component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
strnum_2 = Ladybug_SeparateData(inputList=flatten([readepresult.cooling, readepresult.heating]))  # -> numbers, strings; plug-in component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
strnum_3 = Ladybug_SeparateData(inputList=flatten(readepresult.heating))  # -> numbers, strings; plug-in component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
strnum_4 = Ladybug_SeparateData(inputList=flatten(readepresult.fanElectric))  # -> numbers, strings; plug-in component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
graph = QuickGraph(strnum_2.numbers, SortOrder=0)
ma = MassAddition(Input=flatten(strnum_4.numbers))  # -> Result, PartialResults
ma_2 = MassAddition(Input=flatten(strnum.numbers))  # -> Result, PartialResults
ma_3 = MassAddition(Input=flatten(strnum_3.numbers))  # -> Result, PartialResults
ma_4 = MassAddition(Input=[ma_2.Result, ma_3.Result, ma.Result])  # -> Result, PartialResults
round = Round(Number=ma.Result)  # -> Nearest, Floor, Ceiling
round_2 = Round(Number=ma_3.Result)  # -> Nearest, Floor, Ceiling
round_3 = Round(Number=ma_2.Result)  # -> Nearest, Floor, Ceiling
round_4 = Round(Number=ma_4.Result)  # -> Nearest, Floor, Ceiling
concat_27 = Concatenate(FragmentA="_AnnualCoolingEnergy_", FragmentB=round_3.Ceiling)
concat_28 = Concatenate(FragmentA="_AnnualHeatingEnergy_", FragmentB=round_2.Ceiling)
concat_29 = Concatenate(FragmentA="_AnnualLightingEnergy_", FragmentB=round.Ceiling)
concat_30 = Concatenate(FragmentA="_TotalAnnualEnergy_", FragmentB=round_4.Ceiling)
panel_42 = Panel([concat_27, concat_28, concat_29, concat_30])

exporttoopenstudio_2 = Honeybee_ExportToOpenStudio(
    epwWeatherFile=epw_stat.epwFile,
    HBZones=flatten(setepzoneintcnstr_2),
    HBContext=flatten(hb_epcontextsrf),
    simulationOutputs=flatten(epoutput.simulationOutputs),
    writeOSM=toggle_6,
    runSimulation=toggle_6,
    fileName="proposed",
    workingDir=panel_41)  # -> readMe, osmFileAddress, idfFileAddress, resultFileAddress, eioFileAddress, rddFileAddress, htmlReport, studyFolder, model; plug-in component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

readepresult_2 = Honeybee_ReadEPResult(resultFileAddress=exporttoopenstudio_2.resultFileAddress)  # -> totalThermalLoad, thermalLoadBalance, cooling, heating, electricLight, electricEquip, fanElectric, pumpElectric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; plug-in component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
strnum_5 = Ladybug_SeparateData(inputList=flatten([readepresult_2.cooling, readepresult_2.heating]))  # -> numbers, strings; plug-in component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
strnum_6 = Ladybug_SeparateData(inputList=flatten(readepresult_2.cooling))  # -> numbers, strings; plug-in component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
strnum_7 = Ladybug_SeparateData(inputList=flatten(readepresult_2.fanElectric))  # -> numbers, strings; plug-in component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
strnum_8 = Ladybug_SeparateData(inputList=flatten(readepresult_2.heating))  # -> numbers, strings; plug-in component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
ma_5 = MassAddition(Input=flatten(strnum_7.numbers))  # -> Result, PartialResults
ma_6 = MassAddition(Input=flatten(strnum_8.numbers))  # -> Result, PartialResults
ma_7 = MassAddition(Input=flatten(strnum_6.numbers))  # -> Result, PartialResults
graph_2 = QuickGraph(strnum_5.numbers, SortOrder=0)
ma_8 = MassAddition(Input=[ma_7.Result, ma_6.Result, ma_5.Result])  # -> Result, PartialResults
round_5 = Round(Number=ma_5.Result)  # -> Nearest, Floor, Ceiling
round_6 = Round(Number=ma_6.Result)  # -> Nearest, Floor, Ceiling
round_7 = Round(Number=ma_7.Result)  # -> Nearest, Floor, Ceiling
round_8 = Round(Number=ma_8.Result)  # -> Nearest, Floor, Ceiling
concat_31 = Concatenate(FragmentA="_AnnualCoolingEnergy_", FragmentB=round_7.Ceiling)
concat_32 = Concatenate(FragmentA="_AnnualHeatingEnergy_", FragmentB=round_6.Ceiling)
concat_33 = Concatenate(FragmentA="_AnnualFanEnergy_", FragmentB=round_5.Ceiling)
concat_34 = Concatenate(FragmentA="_TotalAnnualEnergy_", FragmentB=round_8.Ceiling)
panel_43 = Panel([concat_31, concat_32, concat_33, concat_34])

subtraction = Subtraction(A=round_8.Ceiling, B=round_4.Ceiling)
division_5 = Division(A=subtraction, B=round_4.Ceiling)
multiplication_7 = Multiplication(A=division_5, B="10000")
round_9 = Round(Number=multiplication_7)  # -> Nearest, Floor, Ceiling
division_6 = Division(A=round_9.Ceiling, B="100")
concat_35 = Concatenate(FragmentA=division_6, FragmentB="% change in annual energy demand")
panel_44 = Panel(concat_35)

# ==== cluster Cluster
shadeheight = ClusterInput()
shade_depths = ClusterInput()
window_breps = ClusterInput()
shade_breps = ClusterInput()
numofshades = ClusterInput()
windowtowallratio = ClusterInput()
walls = ClusterInput()
cityindex = ClusterInput()
bldgprogramindex = ClusterInput()
walls_2 = Geometry(walls)
shadeheight_2 = Number(shadeheight)
shade_depths_2 = Data(shade_depths)
window_breps_2 = Geometry(window_breps)
shade_breps_2 = Geometry(shade_breps)
numofshades_2 = Data(numofshades)
cityindex_2 = Data(cityindex)
windowtowallratio_2 = Number(windowtowallratio)
bldgprogramindex_2 = Data(bldgprogramindex)

facen = FaceNormals(Mesh=walls_2)  # -> Centers, Normals
item = ListItem(List=facen.Normals, Index="0", Wrap=True)
xy = XYPlane(Origin=Point(0, 0, 0))
Y = UnitY(Factor=1)
series = Series(Start="22.5", Step="45", Count="8")  # -> flatten(Series)
series_2 = Series(Start="22.5", Step="45", Count="7")  # -> flatten(Series)
angle = Angle(VectorA=Y, VectorB=item, Plane=xy)  # -> Angle, Reflex
panel = Panel(["337.5", "0", series_2])
panel_2 = Panel(["360", series])
deg = Degrees(Radians=angle.Angle)  # -> simplify(flatten(Degrees))
larger = LargerThan(FirstNumber=graft(deg), SecondNumber=panel)  # -> LargerThan, OrEqualTo
smaller = SmallerThan(FirstNumber=graft(deg), SecondNumber=panel_2)  # -> SmallerThan, OrEqualTo
multiplication = Multiplication(A=larger.OrEqualTo, B=smaller.SmallerThan)  # -> simplify(Result)
panel_3 = Panel("""0
1""")
item_2 = ListItem(List=multiplication, Index=panel_3, Wrap=True)
cull_i = CullIndex(List=multiplication, Indices=panel_3, Wrap=True)  # -> simplify(List)
ma = MassAddition(Input=item_2)  # -> simplify(Result), PartialResults
series_3 = Series(Start=0, Step=1, Count="8")  # -> flatten(Series)
num = Number([ma.Result, cull_i])
multiplication_2 = Multiplication(A=series_3, B=num)
ma_2 = MassAddition(Input=multiplication_2)  # -> flatten(Result), PartialResults
equals = Equality(FirstNumber=ma_2.Result, SecondNumber=graft(series_3))  # -> Equality, Inequality
cull = CullPattern(List=walls_2, CullPattern=equals.Equality)  # -> simplify(List)
area = Area(Geometry=cull)  # -> simplify(Area), Centroid
subtraction = Subtraction(A="1", B=windowtowallratio_2)
ma_3 = MassAddition(Input=area.Area)  # -> flatten(OpaqueArea), PartialResults
division = Division(A=ma_3.OpaqueArea, B=subtraction)  # -> simplify(flatten(TotalWallArea))
subtraction_2 = Subtraction(A=division, B=ma_3.OpaqueArea)  # -> flatten(GlazingArea)

larger_2 = LargerThan(FirstNumber=subtraction_2, SecondNumber="0")  # -> LargerThan, OrEqualTo
rep = ReplaceText(Text=larger_2.LargerThan, Find="False", Replace="NoGlaz", RecursiveReplace=False)
series_4 = Series(Start=0, Step=1, Count="8")
multiplication_3 = Multiplication(A=rep, B=series_4)
nullrep = ReplaceNulls(Items=multiplication_3, Replacements="-1")  # -> Items, Count
equals_2 = Equality(FirstNumber=nullrep.Items, SecondNumber="-1")  # -> Equality, Inequality
cull_2 = CullPattern(List=multiplication_3, CullPattern=equals_2.Equality)

dim = Dimensions(Surface=window_breps_2)  # -> UDimension, VDimension
rev = ReverseList(List=flatten(shade_breps_2))
division_2 = Division(A=dim.VDimension, B=numofshades_2)  # -> flatten(Result)
weave = Weave(Pattern=larger_2.LargerThan, Stream0=cull_2, Stream1=flatten(division_2), NullGaps=False)
weave_2 = Weave(Pattern=larger_2.LargerThan, Stream0=cull_2, Stream1=flatten(rev), NullGaps=False)
Z = UnitZ(Factor=shadeheight_2)
move = Move(Geometry=flatten(weave_2), Motion=Z)  # -> ShadeAsBrep, Transform
addition = Addition(A=shadeheight_2, B=weave)
division_3 = Division(A=shade_depths_2, B=addition)

# ----
# Class 3 building
# Class 9c building
# shop front
# other
climate_zone = Panel("""6
5
1
2
5
7
5
1
6
6
4""")
panel_4 = Panel("""0
3
2
3
3
1""")
item_3 = ListItem(List=climate_zone, Index=cityindex_2, Wrap=True)
number = Number(expr("x-1", item_3))
item_4 = ListItem(List=panel_4, Index=bldgprogramindex_2, Wrap=True)
path = DataPath(number)

g_value = Number(shadeheight_2)
# DTS: heating and cooling shading multiplier
panel_5 = Panel("0.1")
smaller_2 = SmallerThan(FirstNumber=g_value, SecondNumber=panel_5)  # -> SmallerThan, OrEqualTo
larger_3 = LargerThan(FirstNumber=g_value, SecondNumber=panel_5)  # -> LargerThan, OrEqualTo
smaller_3 = SmallerThan(FirstNumber=g_value, SecondNumber="0.5")  # -> SmallerThan, OrEqualTo
larger_4 = LargerThan(FirstNumber=g_value, SecondNumber="0.5")  # -> LargerThan, OrEqualTo
smaller_4 = SmallerThan(FirstNumber=g_value, SecondNumber="1.2")  # -> SmallerThan, OrEqualTo
larger_5 = LargerThan(FirstNumber=g_value, SecondNumber="1.2")  # -> LargerThan, OrEqualTo
multiplication_4 = Multiplication(A=smaller_2.OrEqualTo, B="1")
multiplication_5 = Multiplication(A=larger_3.LargerThan, B=smaller_3.OrEqualTo)
multiplication_6 = Multiplication(A=larger_4.LargerThan, B=smaller_4.OrEqualTo)
multiplication_7 = Multiplication(A=larger_5.LargerThan, B="1")
rep_2 = ReplaceText(Text=multiplication_4, Find="0", Replace="null", RecursiveReplace=False)
rep_3 = ReplaceText(Text=multiplication_5, Find="0", Replace="null", RecursiveReplace=False)
rep_4 = ReplaceText(Text=multiplication_6, Find="0", Replace="null", RecursiveReplace=False)
rep_5 = ReplaceText(Text=multiplication_7, Find="0", Replace="null", RecursiveReplace=False)
multiplication_8 = Multiplication(A=rep_2, B="0")
multiplication_9 = Multiplication(A=rep_3, B="1")
multiplication_10 = Multiplication(A=rep_4, B="2")
multiplication_11 = Multiplication(A=rep_5, B="3")
addition_2 = Addition(A=multiplication_8, B=multiplication_9, C=multiplication_10, D=multiplication_11)

# ----
# P/H ratio
panel_6 = Panel("5")
multiplication_12 = Multiplication(A=division_3, B=panel_6)
round = Round(Number=multiplication_12)  # -> Nearest, Floor, Ceiling
division_4 = Division(A=round.Floor, B=panel_6)
larger_6 = LargerThan(FirstNumber=division_4, SecondNumber="2")  # -> LargerThan, OrEqualTo
rep_6 = ReplaceText(Text=larger_6.OrEqualTo, Find="False", Replace="<2", RecursiveReplace=False)
series_5 = Series(Start=0, Step=1, Count="8")
multiplication_13 = Multiplication(A=rep_6, B=series_5)
nullrep_2 = ReplaceNulls(Items=multiplication_13, Replacements="-1")  # -> Items, Count
equals_3 = Equality(FirstNumber=nullrep_2.Items, SecondNumber="-1")  # -> Equality, Inequality
cull_3 = CullPattern(List=multiplication_13, CullPattern=equals_3.Inequality)
replace = ReplaceItems(List=division_4, Item="2", Indices=cull_3, Wrap=False)
division_5 = Division(A=replace, B="0.2")  # -> flatten(Result)

panel_7 = Panel("""6
5
1
2
5
7
5
1
6
6
4""")
panel_8 = Panel("""2
1
0
0
1
2
1
0
2
2
1""")
item_5 = ListItem(List=panel_8, Index=cityindex_2, Wrap=True)
multiplication_14 = Multiplication(A=item_5, B="45")
series_6 = Series(Start=multiplication_14, Step=1, Count="45")

panel_9 = Panel("""N
1
1
1
1
1
1
1
1
1
1
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N
1
0.96
0.86
0.66
0.3
0
0
0
0
0
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N
1
0.95
0.82
0.61
0.31
0.02
0
0
0
0
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N
1
0.9
0.73
0.55
0.37
0.19
0.07
0
0
0
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NW
1
1
1
1
1
1
1
1
1
1
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NW
1
0.95
0.85
0.7
0.47
0.15
0
0
0
0
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NW
1
0.93
0.8
0.62
0.41
0.17
0.02
0
0
0
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NW
1
0.91
0.77
0.62
0.48
0.37
0.29
0.21
0.15
0.09
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W
1
1
1
1
1
1
1
1
1
1
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W
1
0.92
0.8
0.66
0.5
0.35
0.21
0.12
0.08
0.04
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W
1
0.91
0.78
0.64
0.52
0.4
0.3
0.22
0.16
0.11
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W
1
0.92
0.8
0.68
0.57
0.49
0.43
0.38
0.34
0.31
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SW
1
1
1
1
1
1
1
1
1
1
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SW
1
0.92
0.83
0.74
0.66
0.6
0.54
0.5
0.46
0.43
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SW
1
0.91
0.81
0.71
0.63
0.56
0.51
0.47
0.44
0.41
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SW
1
0.91
0.8
0.72
0.67
0.64
0.62
0.59
0.56
0.52
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S
1
1
1
1
1
1
1
1
1
1
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S
1
0.94
0.87
0.81
0.77
0.74
0.71
0.69
0.67
0.66
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S
1
0.93
0.86
0.8
0.74
0.7
0.66
0.63
0.6
0.58
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S
1
0.93
0.85
0.77
0.71
0.66
0.62
0.59
0.56
0.53
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SE
1
1
1
1
1
1
1
1
1
1
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SE
1
0.9
0.78
0.69
0.62
0.56
0.52
0.48
0.45
0.42
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SE
1
0.9
0.79
0.7
0.63
0.58
0.53
0.49
0.45
0.41
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SE
1
0.93
0.89
0.83
0.75
0.67
0.6
0.53
0.48
0.43
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E
1
1
1
1
1
1
1
1
1
1
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E
1
0.92
0.79
0.63
0.43
0.22
0.08
0.04
0.02
0.01
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E
1
0.91
0.78
0.64
0.49
0.35
0.23
0.14
0.1
0.05
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E
1
0.9
0.77
0.68
0.61
0.53
0.44
0.36
0.29
0.23
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NE
1
1
1
1
1
1
1
1
1
1
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NE
1
0.95
0.83
0.65
0.41
0.08
0
0
0
0
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NE
1
0.93
0.82
0.66
0.46
0.23
0.04
0
0
0
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NE
1
0.91
0.77
0.63
0.5
0.35
0.22
0.12
0.08
0.04
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""")
partition = PartitionList(List=panel_9, Size="180")  # -> simplify(Chunks)
item_6 = ListItem(List=partition, Index=series_6, Wrap=True)
cull_i_2 = CullIndex(List=item_6, Indices="0", Wrap=True)
multiplication_15 = Multiplication(A=addition_2, B="11")
series_7 = Series(Start=multiplication_15, Step=1, Count="11")
item_7 = ListItem(List=cull_i_2, Index=series_7, Wrap=True)  # -> simplify(Item)
heating_shading_multiplier = ListItem(List=item_7, Index=graft(division_5), Wrap=True)  # -> flatten(Item)

panel_10 = Panel("""N
1
0.79
0.57
0.41
0.32
0.26
0.22
0.2
0.19
0.18
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N
1
0.81
0.61
0.46
0.35
0.28
0.24
0.22
0.2
0.2
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N
1
0.82
0.63
0.49
0.4
0.35
0.32
0.31
0.3
0.3
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N
1
0.78
0.58
0.47
0.43
0.42
0.41
0.41
0.4
0.4
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NW
1
0.84
0.67
0.53
0.43
0.35
0.3
0.25
0.22
0.2
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NW
1
0.84
0.67
0.53
0.42
0.34
0.29
0.26
0.24
0.22
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NW
1
0.84
0.67
0.54
0.44
0.38
0.35
0.32
0.31
0.3
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NW
1
0.83
0.65
0.53
0.45
0.41
0.39
0.38
0.37
0.37
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W
1
0.87
0.72
0.6
0.5
0.43
0.37
0.33
0.29
0.26
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W
1
0.87
0.72
0.6
0.51
0.44
0.38
0.34
0.31
0.29
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W
1
0.87
0.72
0.61
0.52
0.45
0.41
0.37
0.34
0.32
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W
1
0.86
0.71
0.6
0.52
0.47
0.43
0.4
0.39
0.38
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SW
1
0.87
0.73
0.62
0.54
0.48
0.43
0.39
0.36
0.33
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SW
1
0.88
0.75
0.64
0.57
0.5
0.46
0.42
0.39
0.37
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SW
1
0.88
0.74
0.64
0.57
0.51
0.47
0.44
0.42
0.4
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SW
1
0.86
0.73
0.63
0.56
0.51
0.48
0.46
0.45
0.44
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S
1
0.87
0.76
0.68
0.62
0.58
0.56
0.53
0.52
0.5
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S
1
0.9
0.81
0.74
0.68
0.64
0.62
0.59
0.57
0.56
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S
1
0.9
0.8
0.73
0.68
0.64
0.61
0.59
0.57
0.56
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S
1
0.87
0.75
0.67
0.62
0.59
0.57
0.56
0.55
0.54
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SE
1
0.85
0.7
0.58
0.48
0.42
0.38
0.34
0.32
0.3
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SE
1
0.86
0.72
0.61
0.53
0.47
0.43
0.39
0.36
0.34
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SE
1
0.87
0.74
0.64
0.56
0.51
0.48
0.45
0.42
0.41
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SE
1
0.85
0.71
0.61
0.54
0.5
0.48
0.46
0.45
0.44
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E
1
0.86
0.71
0.58
0.47
0.39
0.33
0.29
0.26
0.23
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E
1
0.87
0.72
0.59
0.49
0.42
0.37
0.33
0.3
0.27
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E
1
0.87
0.72
0.6
0.51
0.44
0.39
0.36
0.33
0.31
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E
1
0.86
0.7
0.58
0.49
0.44
0.41
0.39
0.37
0.36
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NE
1
0.84
0.66
0.52
0.4
0.32
0.28
0.24
0.22
0.2
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NE
1
0.85
0.68
0.54
0.42
0.34
0.29
0.26
0.23
0.21
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NE
1
0.86
0.69
0.56
0.46
0.38
0.34
0.32
0.3
0.29
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NE
1
0.83
0.65
0.52
0.44
0.4
0.39
0.38
0.37
0.37
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""")
partition_2 = PartitionList(List=panel_10, Size="180")  # -> simplify(Chunks)
item_8 = ListItem(List=partition_2, Index=series_6, Wrap=True)
cull_i_3 = CullIndex(List=item_8, Indices="0", Wrap=True)
multiplication_16 = Multiplication(A=addition_2, B="11")
series_8 = Series(Start=multiplication_16, Step=1, Count="11")
item_9 = ListItem(List=cull_i_3, Index=series_8, Wrap=True)  # -> simplify(Item)
cooling_shading_multiplier = ListItem(List=item_9, Index=graft(division_5), Wrap=True)  # -> flatten(Item)

series_9 = Series(Start="0", Step=1, Count="8")

shadeasbrep = Geometry(move.ShadeAsBrep)
shadeasbrep_2 = ClusterOutput(shadeasbrep)

# ----
# DTS Glazing Calc
panel_11 = Panel("""0
0
0
-0.16
-0.06
-0.37
-0.41
-0.87
0.8
1.2
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""")
panel_12 = Panel("""0.067
0.08
0.18
0.13
0.132
0.158
0.217
0.181
0.091
0.109
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""")
partition_3 = PartitionList(List=panel_11, Size="24")  # -> simplify(Chunks)
partition_4 = PartitionList(List=panel_12, Size="4")  # -> simplify(Chunks)
series_10 = Series(Start="16", Step=1, Count="8")
series_11 = Series(Start="8", Step=1, Count="8")
series_12 = Series(Start="0", Step=1, Count="8")
item_10 = ListItem(List=partition_3, Index=series_11, Wrap=True)
item_11 = ListItem(List=partition_3, Index=series_12, Wrap=True)
item_12 = ListItem(List=partition_3, Index=series_10, Wrap=True)
ca = ListItem(List=item_11, Index=number, Wrap=True)  # -> flatten(Item)
cb = ListItem(List=item_10, Index=number, Wrap=True)  # -> flatten(Item)
cc = ListItem(List=item_12, Index=number, Wrap=True)  # -> flatten(Item)
branch = TreeBranch(Tree=partition_4, Path=path, MaintainPaths=True)
panel_13 = Panel(ca)
energy_index = ListItem(List=branch, Index=item_4, Wrap=True)
multiplication_17 = Multiplication(EI=energy_index, GlazArea=subtraction_2)
panel_14 = Panel(windowtowallratio_2)
division_6 = Division(A=multiplication_17, WWR=windowtowallratio_2)
panel_15 = Panel("""7
7
7
7
7
7
7
7""")
multiplication_18 = Multiplication(Cb=cb, CoolingShadingMultiplier=cooling_shading_multiplier)
multiplication_19 = Multiplication(Ca=ca, HeatingShadingMultiplier=heating_shading_multiplier)
division_7 = Division(A=division_6, B=subtraction_2)
multiplication_20 = Multiplication(A=panel_15, B=cc)
addition_3 = Addition(A=multiplication_19, B=multiplication_18)
subtraction_3 = Subtraction(A=division_7, B=multiplication_20)
division_8 = Division(A=subtraction_3, B=addition_3)
addition_4 = Addition(A=multiplication_19, B=multiplication_18)
division_9 = Division(A=division_6, B=subtraction_2)

smaller_5 = SmallerThan(FirstNumber=division_8, SecondNumber="0.01")  # -> SmallerThan, OrEqualTo
rep_7 = ReplaceText(Text=smaller_5.OrEqualTo, Find="False", RecursiveReplace=False)
multiplication_21 = Multiplication(A=rep_7, B=series_9)
nullrep_3 = ReplaceNulls(Items=multiplication_21, Replacements="-1")  # -> Items, Count
equals_4 = Equality(FirstNumber=nullrep_3.Items, SecondNumber="-1")  # -> Equality, Inequality
cull_4 = CullPattern(List=multiplication_21, CullPattern=equals_4.Inequality)

larger_7 = LargerThan(FirstNumber=division_8, SecondNumber="0.99")  # -> LargerThan, OrEqualTo
rep_8 = ReplaceText(Text=larger_7.OrEqualTo, Find="False", RecursiveReplace=False)
multiplication_22 = Multiplication(A=rep_8, B=series_9)
nullrep_4 = ReplaceNulls(Items=multiplication_22, Replacements="-1")  # -> Items, Count
equals_5 = Equality(FirstNumber=nullrep_4.Items, SecondNumber="-1")  # -> Equality, Inequality
cull_5 = CullPattern(List=multiplication_22, CullPattern=equals_5.Inequality)

# ----
# replace SHGC values >0.99
replace_2 = ReplaceItems(List=division_8, Item="0.99", Indices=cull_5, Wrap=False)

# ----
# replace SHGC values <0.01
replace_3 = ReplaceItems(List=replace_2, Item="0.01", Indices=cull_4, Wrap=False)

multiplication_23 = Multiplication(A=replace_3, B=addition_4)
subtraction_4 = Subtraction(A=division_9, B=multiplication_23)
division_10 = Division(A=subtraction_4, B=cc)

equals_6 = Equality(FirstNumber=cc, SecondNumber="0")  # -> Equality, Inequality
txt = Text(equals_6.Equality)
rep_9 = ReplaceText(Text=txt, Find="False", RecursiveReplace=False)
rep_10 = ReplaceText(Text=rep_9, Find="True", Replace="1", RecursiveReplace=False)
multiplication_24 = Multiplication(A=rep_10, B=series_9)
cull_6 = CullPattern(List=multiplication_24, CullPattern=equals_6.Equality)
int = Integer(cull_6)
replace_4 = ReplaceItems(List=division_10, Item="1", Indices=int, Wrap=False)

larger_8 = LargerThan(FirstNumber=replace_4, SecondNumber="7")  # -> LargerThan, OrEqualTo
rep_11 = ReplaceText(Text=larger_8.LargerThan, Find="False", RecursiveReplace=False)
multiplication_25 = Multiplication(A=rep_11, B=series_9)
nullrep_5 = ReplaceNulls(Items=multiplication_25, Replacements="-1")  # -> Items, Count
equals_7 = Equality(FirstNumber=nullrep_5.Items, SecondNumber="-1")  # -> Equality, Inequality
cull_7 = CullPattern(List=multiplication_25, CullPattern=equals_7.Inequality)
replace_5 = ReplaceItems(List=replace_4, Item="7", Indices=cull_7, Wrap=False)

smaller_6 = SmallerThan(FirstNumber=replace_4, SecondNumber="1")  # -> SmallerThan, OrEqualTo
rep_12 = ReplaceText(Text=smaller_6.OrEqualTo, Find="False", RecursiveReplace=False)
multiplication_26 = Multiplication(A=rep_12, B=series_9)
nullrep_6 = ReplaceNulls(Items=multiplication_26, Replacements="-1")  # -> Items, Count
equals_8 = Equality(FirstNumber=nullrep_6.Items, SecondNumber="-1")  # -> Equality, Inequality
cull_8 = CullPattern(List=multiplication_26, CullPattern=equals_8.Inequality)

# ----
# replace UVal <1.0
replace_6 = ReplaceItems(List=replace_5, Item="1", Indices=cull_8, Wrap=False)

# ----
# recheck SHGC with revised UVal
division_11 = Division(A=division_6, B=subtraction_2)
multiplication_27 = Multiplication(A=replace_6, B=cc)
subtraction_5 = Subtraction(A=division_11, B=multiplication_27)
division_12 = Division(A=subtraction_5, B=addition_3)

multiplication_28 = Multiplication(A=division_12, B="100")
multiplication_29 = Multiplication(A=replace_6, B="10")
round_2 = Round(Number=multiplication_28)  # -> Nearest, Floor, Ceiling
round_3 = Round(Number=multiplication_29)  # -> Nearest, Floor, Ceiling
division_13 = Division(A=round_2.Floor, B="100")
division_14 = Division(A=round_3.Floor, B="10")
panel_16 = Panel("""1_
2_
3_
4_
5_
6_
7_
8_""")
panel_17 = Panel("""n
nw
w
sw
s
se
e
ne""")
panel_18 = Panel(division_13)
nullrep_7 = ReplaceNulls(Items=division_14, Replacements="0.35")  # -> Items, Count
nullrep_8 = ReplaceNulls(Items=division_13, Replacements="0")  # -> Items, Count
concat = Concatenate(
    FragmentF=panel_16,
    FragmentA=panel_17,
    FragmentE="_",
    FragmentB=nullrep_7.Items,
    FragmentC="_",
    FragmentD=nullrep_8.Items)  # -> flatten(Result)
panel_19 = Panel(concat)

shgc = Data(nullrep_8.Items)
uvalues = Data(nullrep_7.Items)
constructionnames = Data(concat)
shgc_2 = ClusterOutput(shgc)
uvalues_2 = ClusterOutput(uvalues)
constructionnames_2 = ClusterOutput(constructionnames)

# ==== cluster Cluster_2
honeybeezones = ClusterInput()
walls = ClusterInput()
honeybeezones_2 = Geometry(honeybeezones)
walls_2 = Geometry(walls)

facen = FaceNormals(Mesh=walls_2)  # -> Centers, Normals
item = ListItem(List=facen.Normals, Index="0", Wrap=True)
Y = UnitY(Factor=1)
xy = XYPlane(Origin=Point(0, 0, 0))
series = Series(Start="22.5", Step="45", Count="8")  # -> flatten(Series)
series_2 = Series(Start="22.5", Step="45", Count="7")  # -> flatten(Series)
angle = Angle(VectorA=Y, VectorB=item, Plane=xy)  # -> Angle, Reflex
panel = Panel(["360", series])
panel_2 = Panel(["337.5", "0", series_2])
deg = Degrees(Radians=angle.Angle)  # -> simplify(flatten(Degrees))
larger = LargerThan(FirstNumber=graft(deg), SecondNumber=panel_2)  # -> LargerThan, OrEqualTo
smaller = SmallerThan(FirstNumber=graft(deg), SecondNumber=panel)  # -> SmallerThan, OrEqualTo
multiplication = Multiplication(A=larger.OrEqualTo, B=smaller.SmallerThan)  # -> simplify(Result)
panel_3 = Panel("""0
1""")
item_2 = ListItem(List=multiplication, Index=panel_3, Wrap=True)
cull_i = CullIndex(List=multiplication, Indices=panel_3, Wrap=True)  # -> simplify(List)
ma = MassAddition(Input=item_2)  # -> simplify(Result), PartialResults
series_3 = Series(Start=0, Step=1, Count="8")  # -> flatten(Series)
num = Number([ma.Result, cull_i])
multiplication_2 = Multiplication(A=series_3, B=num)
ma_2 = MassAddition(Input=multiplication_2)  # -> flatten(Result), PartialResults
equals = Equality(FirstNumber=ma_2.Result, SecondNumber=graft(series_3))  # -> Equality, Inequality
cull = CullPattern(List=honeybeezones_2, CullPattern=equals.Equality)  # -> simplify(List)

honeybeezones_3 = Geometry(cull)
honeybeezones_4 = ClusterOutput(honeybeezones_3)
